# Dynamo graph 2.0.1-Set_AptNo_To_Rooms_02-0.1.4.dyn (Dynamo 2.0.1.5055)

# group: Set these values before running
levels = Levels(index=13)
code_block = CodeBlock { "NSA"; }

# group: Get all areas from a specific level
categories_areas = Categories(index=74)
# note: Custom Node: archilab v.2019.2.14
byCategoryAndLevel = archilab.Revit.Selection.Select.ByCategoryAndLevel(category=categories_areas, level=levels)
code_block_2 = CodeBlock { "Area Scheme Id"; }
getParameterValueByName = Element.GetParameterValueByName(element=byCategoryAndLevel, parameterName=code_block_2)
id = Element.Id(element=getParameterValueByName)
string_from_object = FromObject(obj=id)
all_elements_of_category = ElementsOfCategory()  # unwired: Category

# group: Create Dictionary of Area Schemes against Area Scheme ID's
element_types_area_scheme = ElementTypes(index=18)
all_elements_of_type = ElementsOfType(element_type=element_types_area_scheme)
id_2 = Element.Id(element=all_elements_of_type)
string_from_object_2 = FromObject(obj=id_2)
name = Element.Name(element=all_elements_of_type)
byKeysValues = DesignScript.Builtin.Dictionary.ByKeysValues(keys=string_from_object_2, values=name)
valueAtKey = DesignScript.Builtin.Dictionary.ValueAtKey(dictionary=byKeysValues, key=string_from_object)
eq = valueAtKey == code_block

filterByBoolMask = List.FilterByBoolMask(list=byCategoryAndLevel, mask=eq)
watch = Watch(filterByBoolMask.in)

# group: Create Solids from Area Boundaries
boundaries = Rhythm.Revit.Elements.Areas.Boundaries(area=filterByBoolMask.in)
# note: LIst.FirstItem gets what I hope is the primary boundary for the apartment - internal boundaries prevent the script from running correctly and cause the data to be mismatched.
# May need to find a more robust way of doing this.
code_block_3 = CodeBlock { 0.01; }
code_block_4 = CodeBlock { 0; }
code_block_5 = CodeBlock { 1; }
byCoordinates = Vector.ByCoordinates(x=code_block_4, y=code_block_4, z=code_block_5)
code_block_6 = CodeBlock { 1000; }

firstItem = List.FirstItem(list=boundaries@L3)

# group (continued): Create Solids from Area Boundaries
byJoinedCurves = PolyCurve.ByJoinedCurves(curves=firstItem@L2, joinTolerance=code_block_3)
isNull = Object.IsNull(obj=byJoinedCurves)
filterByBoolMask_2 = List.FilterByBoolMask(list=byJoinedCurves, mask=isNull)
extrudeAsSolid = Curve.ExtrudeAsSolid(curve=filterByBoolMask_2.out, direction=byCoordinates, distance=code_block_6)

# group: Get 'Number' for select areas
code_block_7 = CodeBlock { ["PlotNo_JMA", "TypeNo_JMA"]; }
# note: This is essentially whatever parameter is carrying the apartment number - could be AptNo_JMA or similar.
getParameterValueByName_2 = Element.GetParameterValueByName(element=filterByBoolMask.in, parameterName=code_block_7@L2, lacing=Longest)
filterByBoolMask_3 = List.FilterByBoolMask(list=getParameterValueByName_2, mask=isNull)

watch_2 = Watch(filterByBoolMask_3.out)

# group: Get rooms and filter out unplaced
categories_rooms = Categories(index=425)
byCategoryAndLevel_2 = archilab.Revit.Selection.Select.ByCategoryAndLevel(category=categories_rooms, level=levels)
code_block_8 = CodeBlock { "Area"; }
getParameterValueByName_3 = Element.GetParameterValueByName(element=byCategoryAndLevel_2, parameterName=code_block_8)
code_block_9 = CodeBlock { 0; }
# note: Rooms that have been placed and deleted still retain their level info so will will be selected by 'Select.ByCategoryAndLevel' - to filter these out look at Room area - the blanks are unplaced.  Rooms that have been created within a schedule but not placed will not appear at all using this method.
gt = getParameterValueByName_3 > code_block_9
isNull_2 = Object.IsNull(obj=gt)
filterByBoolMask_4 = List.FilterByBoolMask(list=byCategoryAndLevel_2, mask=isNull_2)

# group: Create extruded cylinder for selected rooms
location = Room.Location(room=filterByBoolMask_4.out)
code_block_10 = CodeBlock { 100; }
byCenterPointRadius = Circle.ByCenterPointRadius(centerPoint=location, radius=code_block_10)
code_block_11 = CodeBlock { 0; }
code_block_12 = CodeBlock { 1; }
byCoordinates_2 = Vector.ByCoordinates(x=code_block_11, y=code_block_11, z=code_block_12)
code_block_13 = CodeBlock { 1000; }
extrudeAsSolid_2 = Curve.ExtrudeAsSolid(curve=byCenterPointRadius, direction=byCoordinates_2, distance=code_block_13)
isNull_3 = Object.IsNull(obj=extrudeAsSolid_2)
filterByBoolMask_5 = List.FilterByBoolMask(list=extrudeAsSolid_2, mask=isNull_3)

# group: Intersect Geometry
# note: Intersect Areas and Rooms.  Geometry input to use @L2 and Lacing set to Longest.
doesIntersect = Geometry.DoesIntersect(geometry=filterByBoolMask_5.out@L2, other=extrudeAsSolid, lacing=Longest)

# group: Filter Elements to keep lists in sync with problem rooms
# note: Filters out any Nulls from original element list to keep everything in sync.
filterByBoolMask_6 = List.FilterByBoolMask(list=filterByBoolMask_4.out, mask=filterByBoolMask_5.in)

# group: List Failed Rooms, number and ID's
watch_3 = Watch(filterByBoolMask_4.in)
watch_4 = Watch(filterByBoolMask_6.in)
join = List.Join(list0=watch_3, list1=watch_4)
code_block_14 = CodeBlock { ["Name", "Number", "Area"]; }
getParameterValueByName_4 = Element.GetParameterValueByName(element=join, parameterName=code_block_14@L2, lacing=Longest)
transpose = List.Transpose(lists=getParameterValueByName_4)
id_3 = Element.Id(element=join)
list_create = List.Create(item0=id_3)
join_2 = List.Join(list0=transpose, list1=list_create)
transpose_2 = List.Transpose(lists=join_2)
watch_5 = Watch(transpose_2)

watch_6 = Watch(boundaries)
transpose_3 = List.Transpose(lists=filterByBoolMask_3.out)

# group: Match data and write values
filterByBoolMask_7 = List.FilterByBoolMask(list=filterByBoolMask_4.out@L2, mask=doesIntersect, lacing=Longest)
# note: Each list of rooms is filtered against Each area in turn and then matched to the extracted area number (apartment number)
watch_7 = Watch(filterByBoolMask_7.in)
setParameterByName = Element.SetParameterByName(element=filterByBoolMask_7.in@L2, lacing=Longest)  # unwired: parameterName, value
combine = List.Combine(comb=setParameterByName, list1=code_block_7, list2=transpose_3)

watch_8 = Watch(filterByBoolMask_7.in)
