# Dynamo graph 1.3.2-Parameter_Add_Prefix-0.0.1.dyn (Dynamo 1.3.3.4111)

categories = Categories("Windows")
all_elements_of_category = ElementsOfCategory(categories)
code_block = CodeBlock { "Mark"; }
code_block_2 = CodeBlock { "WN-"; }
code_block_3 = CodeBlock { "Mark"; }
getParameterValueByName = Element.GetParameterValueByName(element=all_elements_of_category, parameterName=code_block_3)
code_block_family_type_name = CodeBlock(var0=code_block_2, var1=getParameterValueByName) { (var0)+(var1); }  # "Code Block : Family type name generator"
setParameterByName = Element.SetParameterByName(element=all_elements_of_category, parameterName=code_block, value=code_block_family_type_name)
